# Grasshopper definition SKILL1 ARDUINO 1 GSR.gh (Grasshopper 1.0.7)
# plug-ins: Human

file_path = FilePath("E:\桌面\ARDUINO\08.ARDUINO PLAN2\wctmsb.csv")
read_file = ReadFile(File=file_path, PerLineParse=True)
number_slider = Slider(90, range=0..100)
cull_index = CullIndex(List=read_file, Indices=0, Wrap=True)
geo = Geometry(<brep referenced from the Rhino model>)
panel = Panel(read_file)
text_split = TextSplit(Text=cull_index, Separators=",")
panel_2 = Panel(text_split)
sdivide = DivideSurface(Surface=reparameterize(geo), UCount=number_slider, VCount=Slider(68, range=0..100))  # -> simplify(Points), Normals, Parameters
image = ImageSampler(sdivide.Parameters, FilePath="E:\桌面\HUIDU.png", Filter="Value", Interpolate=True, Umax=1, Umin=0, Vmax=1, Vmin=0, Wrap=1)
panel_3 = Panel(image)
list_item = ListItem(List=text_split, Index="9", Wrap=True)  # -> simplify(Item)
list_item_2 = ListItem(List=text_split, Index="11", Wrap=True)
panel_4 = Panel(list_item_2)
list_item_3 = ListItem(List=text_split, Index="0", Wrap=True)  # -> graft(Item), graft(Item1)
panel_5 = Panel(sdivide.Points)
graph = GraphMapper(image, x0=0, x1=1, y0=0, y1=1, container_name="Bezier", cpx=[0, 0.4576659203, 0.5512752533, 1], cpy=[0, 0, 1, 1])
bounds = Bounds(Numbers=flatten(list_item))
unit_z = UnitZ(Factor=list_item_2)
Z = UnitZ(Factor=image)
panel_6 = Panel(list_item_3.Item)
construct_point = ConstructPoint(XCoordinate=list_item_3.Item, YCoordinate=list_item_3.Item1, ZCoordinate=list_item)
panel_7 = Panel(list_item)
multiplication = Multiplication(A=Z, B=Slider(500, range=0..500))
move = Move(Geometry=sdivide.Points, Motion=multiplication)  # -> Geometry, reverse(Transform)
deconstruct_domain = DeconstructDomain(Domain=bounds)  # -> Start, End
move_2 = Move(Geometry=construct_point, Motion=unit_z)  # -> Geometry, Transform
srfgrid = SurfaceFromPoints(Points=flatten(move.Geometry), UCount=expr("x+1", number_slider), Interpolate=False)
gradient = Gradient(
    LowerLimit=deconstruct_domain.Start,
    UpperLimit=deconstruct_domain.End,
    Parameter=list_item,
    stops=[0: RGB(75, 107, 169), 0.159: RGB(173, 203, 249), 0.416: RGB(254, 244, 84), 0.722: RGB(234, 126, 0), 1: RGB(234, 38, 0)])
line = Line(StartPoint=move_2.Geometry, EndPoint=construct_point)
series = Series(Start=0, Step="10", Count="150")
xy = XYPlane(Origin=Point(0, 0, 0))
contour = ContourEx(Shape=srfgrid, Plane=xy, Offsets=series)
multiplication_2 = Multiplication(A=Slider(100, range=0..100), B=Slider(7, range=0..10))
custom_preview = CustomPreview(Geometry=line, Material=gradient)
custom_preview_2 = CustomPreview(Geometry=move_2.Geometry, Material=gradient)
unit_z_2 = UnitZ(Factor=multiplication_2)
createattributes = CreateAttributes(Color=gradient, enableFullPath=False)
move_3 = Move(Geometry=contour, Motion=unit_z_2)  # -> Geometry, Transform
boolean_toggle = BooleanToggle(False)
bake = BakeGeometry(Bake=boolean_toggle, Geometry=construct_point, Attributes=createattributes, DeleteOldBakes=False, PreserveTrees=False)
eval = EvaluateCurve(Curve=move_3.Geometry, Parameter=0)  # -> Point, Tangent, Angle
bake_geometry = BakeGeometry(Bake=boolean_toggle, Geometry=line, Attributes=createattributes, DeleteOldBakes=False, PreserveTrees=False)
pdecon = Deconstruct(Point=flatten(eval.Point))  # -> XComponent, YComponent, ZComponent
bnd = Bounds(Numbers=pdecon.ZComponent)
dedomain = DeconstructDomain(Domain=bnd)  # -> Start, End
gradient_2 = Gradient(
    LowerLimit=dedomain.End,
    UpperLimit=dedomain.Start,
    Parameter=pdecon.ZComponent,
    stops=[0: RGB(234, 38, 0), 0.25: RGB(234, 126, 0), 0.5: RGB(254, 244, 84), 0.75: RGB(173, 203, 249), 1: RGB(75, 107, 169)])
preview = CustomPreview(Geometry=flatten(move_3.Geometry), Material=gradient_2)
createatts = CreateAttributes(Color=gradient_2, GroupIndices="1", enableFullPath=False)
bake_geometry_2 = BakeGeometry(Bake=False, DeleteOldBakes=False, PreserveTrees=False)
bake_2 = BakeGeometry(Bake=<missing>, Geometry=flatten(<missing>), Attributes=<missing>, DeleteOldBakes=False, PreserveTrees=False)
bake_geometry_3 = BakeGeometry(Bake=Button(), Geometry=gradient_2, Attributes=gradient_2, DeleteOldBakes=False, PreserveTrees=False)
