# Grasshopper definition SKILL1 ARDUINO 2 SPEED.gh (Grasshopper 1.0.7)
# plug-ins: Human, Bifocals

unit_z = UnitZ(Factor=1)
surface = Surface(<surface referenced from the Rhino model>)
point = Point([<point referenced from the Rhino model> x486])
number_slider = Slider(199, range=0..1000)
number_slider_2 = Slider(200, range=0..1000)
number_slider_3 = Slider(90, range=0..100)
geo = Geometry(<brep referenced from the Rhino model>)
unit_z_2 = UnitZ(Factor=number_slider)
unit_z_3 = UnitZ(Factor=1)
unit_z_4 = UnitZ(Factor=number_slider)
project_point = ProjectPoint(Point=point, Direction=expr("-x", unit_z), Geometry=surface)  # -> Point, Index
polyline = PolyLine(Vertices=point, Closed=False)
negative = Negative(Value=unit_z_2)
sdivide = DivideSurface(Surface=reparameterize(geo), UCount=number_slider_3, VCount=Slider(68, range=0..100))  # -> simplify(Points), Normals, Parameters
negative_2 = Negative(Value=unit_z_4)
negative_3 = Negative(Value=unit_z_3)
move = Move(Geometry=point, Motion=negative)  # -> Geometry, Transform
panel = Panel(sdivide.Points)
image = ImageSampler(
    sdivide.Parameters,
    FilePath="E:\桌面\ARDUINO\08.ARDUINO PLAN2\HEAT SPEED.png",
    Filter="Value",
    Interpolate=True,
    Umax=1,
    Umin=0,
    Vmax=1,
    Vmin=0,
    Wrap=1)
panel_2 = Panel(image)

polyline_2 = PolyLine(Vertices=project_point.Point, Closed=False)
move_2 = Move(Geometry=polyline, Motion=negative_2)  # -> Geometry, Transform

Z = UnitZ(Factor=image)
graph = GraphMapper(image, x0=0, x1=1, y0=0, y1=1, container_name="Bezier", cpx=[0, 1, 0, 1], cpy=[0, 0, 1, 1])
line_sdl = LineSDL(Start=point, Direction=negative_3, Length=number_slider)
line = Line(StartPoint=move.Geometry, EndPoint=project_point.Point)
multiplication = Multiplication(A=Z, B=Slider(500, range=0..500))
colour_swatch = ColourSwatch(SwatchColor=RGB(191, 170, 111))
colour_swatch_2 = ColourSwatch(SwatchColor=RGB(110, 120, 133))
move_3 = Move(Geometry=sdivide.Points, Motion=multiplication)  # -> Geometry, reverse(Transform)
colour_swatch_3 = ColourSwatch(SwatchColor=RGB(112, 112, 112))
custom_preview = CustomPreview(Geometry=[polyline_2, move_2.Geometry], Material=colour_swatch)
custom_preview_2 = CustomPreview(Geometry=line_sdl, Material=colour_swatch_2)
custom_preview_3 = CustomPreview(Geometry=line, Material=colour_swatch_3)
srfgrid = SurfaceFromPoints(Points=flatten(move_3.Geometry), UCount=expr("x+1", number_slider_3), Interpolate=False)
createattributes = CreateAttributes(Color=colour_swatch_3, enableFullPath=False)
createattributes_2 = CreateAttributes(Color=colour_swatch, enableFullPath=False)
createattributes_3 = CreateAttributes(Color=colour_swatch_2, enableFullPath=False)
series = Series(Start=0, Step="10", Count="150")
xy = XYPlane(Origin=Point(0, 0, 0))
multiplication_2 = Multiplication(A=Slider(100, range=0..100), B=Slider(7, range=0..10))
contour = ContourEx(Shape=srfgrid, Plane=xy, Offsets=series)
unit_z_5 = UnitZ(Factor=multiplication_2)
bake = BakeGeometry(Bake=<missing>, Geometry=<missing>, Attributes=<missing>, DeleteOldBakes=False, PreserveTrees=False)
move_4 = Move(Geometry=contour, Motion=unit_z_5)  # -> Geometry, Transform
bake_geometry = BakeGeometry(Bake=Button(), Geometry=line, Attributes=createattributes, DeleteOldBakes=False, PreserveTrees=False)
bake_geometry_2 = BakeGeometry(Bake=Button(), Geometry=line_sdl, Attributes=createattributes_3, DeleteOldBakes=False, PreserveTrees=False)
bake_geometry_3 = BakeGeometry(
    Bake=Button(),
    Geometry=[polyline_2, move_2.Geometry],
    Attributes=createattributes_2,
    DeleteOldBakes=False,
    PreserveTrees=False)
eval = EvaluateCurve(Curve=move_4.Geometry, Parameter=0)  # -> Point, Tangent, Angle
pdecon = Deconstruct(Point=flatten(eval.Point))  # -> XComponent, YComponent, ZComponent
bnd = Bounds(Numbers=pdecon.ZComponent)
dedomain = DeconstructDomain(Domain=bnd)  # -> Start, End
gradient = Gradient(
    LowerLimit=dedomain.End,
    UpperLimit=dedomain.Start,
    Parameter=pdecon.ZComponent,
    stops=[0: RGB(234, 38, 0), 0.25: RGB(234, 126, 0), 0.5: RGB(254, 244, 84), 0.75: RGB(173, 203, 249), 1: RGB(75, 107, 169)])
preview = CustomPreview(Geometry=flatten(move_4.Geometry), Material=gradient)
createatts = CreateAttributes(Color=gradient, GroupIndices="1", enableFullPath=False)
bake_geometry_4 = BakeGeometry(Bake=Button(), Geometry=gradient, Attributes=gradient, DeleteOldBakes=False, PreserveTrees=False)
